# Dynamo graph GeoTableReport.dyn (Dynamo 3.2.2.5494)
# author: Autodesk
# Extract Civil 3D rail alignment geotable data and generate XML reports

data_extractor_from_civil_3d = Python()  # "Data Extractor from Civil 3D Project"; CPython3; unwired: IN[0]
# ---------- data_extractor_from_civil_3d.python (447 lines) ----------
"""
Civil 3D Rail Alignment Geotable Data Extractor for Dynamo
This script extracts rail alignment geotable data from Civil 3D documents
and prepares it for XML report generation.

Usage in Dynamo:
- Import this script as a Python Script node
- Connect Civil 3D document and alignment inputs
- Outputs structured data ready for XML formatting
"""

import clr
import sys

# Add Civil 3D API references - only essential ones for Dynamo
try:
    clr.AddReference('AeccDbMgd')
    clr.AddReference('AcMgd')
    clr.AddReference('AcCoreMgd')
    clr.AddReference('AcDbMgd')
except:
    pass  # Some references may already be loaded

# Import Civil 3D namespaces
from Autodesk.Civil.ApplicationServices import *
from Autodesk.Civil.DatabaseServices import *
from Autodesk.AutoCAD.ApplicationServices import Application
from Autodesk.AutoCAD.DatabaseServices import *
from Autodesk.AutoCAD.Geometry import *
from System.Collections.Generic import List
from System import *

# Import Reference for out parameters
try:
    from clr import Reference
except:
    Reference = None  # Fallback if not available


class GeoTableDataExtractor:
    """Extract geotable data from Civil 3D rail alignments"""
    
    def __init__(self, document=None):
        """Initialize the extractor with Civil 3D document"""
        if document is None:
            self.civil_doc = CivilApplication.ActiveDocument
        else:
            self.civil_doc = document
        
        self.acad_doc = Application.DocumentManager.MdiActiveDocument
        self.db = self.acad_doc.Database
        
    def get_all_alignments(self):
        """Get all alignments from the Civil 3D document"""
        alignments = []
        
        try:
            trans = self.db.TransactionManager.StartTransaction()
            
            # Get alignment collection
            alignment_ids = self.civil_doc.GetAlignmentIds()
            
            for oid in alignment_ids:
                alignment = trans.GetObject(oid, OpenMode.ForRead)
                
                # Safely get properties with fallbacks and convert to Python types
                try:
                    start_station = float(alignment.StartingStation)
                except:
                    start_station = 0.0
                
                try:
                    end_station = float(alignment.EndingStation)
                except:
                    try:
                        end_station = float(alignment.Length) if hasattr(alignment, 'Length') else 0.0
                    except:
                        end_station = 0.0
                
                # Convert all .NET types to Python types
                alignments.append({
                    'id': str(oid),
                    'name': str(alignment.Name) if hasattr(alignment, 'Name') else 'Unknown',
                    'description': str(alignment.Description) if hasattr(alignment, 'Description') else '',
                    'length': float(alignment.Length) if hasattr(alignment, 'Length') else 0.0,
                    'start_station': start_station,
                    'end_station': end_station,
                    'object': alignment
                })
            
            trans.Commit()
            trans.Dispose()
            
        except Exception as e:
            if trans:
                trans.Abort()
                trans.Dispose()
            raise Exception("Error retrieving alignments: " + str(e))
        
        return alignments
    
    def extract_alignment_stations(self, alignment, interval=None):
        """Extract station data along an alignment"""
        stations_data = []
        
        if interval is None:
            interval = 10.0  # Default 10 unit interval
        
        try:
            start_station = float(str(alignment.StartingStation))
            end_station = float(str(alignment.EndingStation))
            current_station = start_station
            
            # Sample stations along the alignment
            while current_station <= end_station:
                try:
                    # Create a simple station entry with Python native types
                    station_data = {
                        'station': float(str(current_station)),
                        'x': 0.0,  # Will try to get actual coordinates
                        'y': 0.0,
                        'z': 0.0,
                        'direction': 0.0,
                        'offset': 0.0
                    }
                    
                    # Try to get actual point coordinates using different methods
                    try:
                        # Method 1: Try GetStationOffsetElevationAtXY (inverse might exist)
                        # Actually, let's use the polyline representation
                        polyline = alignment.GetPolyline()
                        if polyline:
                            # Get a point along the polyline
                            # This is approximate but will work
                            param = float(str((current_station - start_station) / (end_station - start_station)))
                            point = polyline.GetPointAtParameter(param * float(str(polyline.EndParam)))
                            station_data['x'] = float(str(point.X))
                            station_data['y'] = float(str(point.Y))
                            station_data['z'] = float(str(point.Z))
                    except:
                        # If we can't get coordinates, at least record the station
                        pass
                    
                    stations_data.append(station_data)
                    
                except Exception as e:
                    # Skip problematic stations
                    pass
                
                current_station += interval
            
            # Always include end station
            if len(stations_data) > 0 and abs(stations_data[-1]['station'] - float(str(end_station))) > 0.001:
                try:
                    station_data = {
                        'station': float(str(end_station)),
                        'x': 0.0,
                        'y': 0.0,
                        'z': 0.0,
                        'direction': 0.0,
                        'offset': 0.0
                    }
                    
                    try:
                        polyline = alignment.GetPolyline()
                        if polyline:
                            point = polyline.EndPoint
                            station_data['x'] = float(str(point.X))
                            station_data['y'] = float(str(point.Y))
                            station_data['z'] = float(str(point.Z))
                    except:
                        pass
                    
                    stations_data.append(station_data)
                except:
                    pass
                    
        except Exception as e:
            # Return what we have even if there's an error
            pass
        
        return stations_data
    
    def extract_alignment_curves(self, alignment):
        """Extract curve data from alignment entities"""
        curves_data = []
        
        try:
            # Get alignment entities (tangents, curves, spirals)
            entities = alignment.Entities
            
            # Use Python-style iteration instead of .NET Item indexing
            entity_index = 0
            for entity in entities:
                try:
                    # Safely get entity type
                    try:
                        entity_type = str(entity.EntityType)
                    except:
                        entity_type = 'Unknown'
                    
                    # Build entity data with very safe property access
                    entity_data = {
                        'index': entity_index,
                        'type': entity_type
                    }
                    
                    # Try to get basic properties
                    try:
                        entity_data['start_station'] = float(entity.StartStation)
                    except:
                        entity_data['start_station'] = 0.0
                    
                    try:
                        entity_data['end_station'] = float(entity.EndStation)
                    except:
                        entity_data['end_station'] = 0.0
                    
                    try:
                        entity_data['length'] = float(entity.Length)
                    except:
                        entity_data['length'] = 0.0
                    
                    # Add type-specific data with safe property access
                    if 'Arc' in entity_type or 'Curve' in entity_type:
                        try:
                            entity_data['radius'] = float(entity.Radius)
                        except:
                            entity_data['radius'] = 0.0
                        try:
                            entity_data['chord_length'] = float(entity.ChordLength)
                        except:
                            entity_data['chord_length'] = 0.0
                        try:
                            entity_data['direction'] = 'CW' if entity.Clockwise else 'CCW'
                        except:
                            entity_data['direction'] = 'Unknown'
                        
                    elif 'Spiral' in entity_type:
                        try:
                            entity_data['radius_in'] = float(entity.RadiusIn)
                        except:
                            entity_data['radius_in'] = 0.0
                        try:
                            entity_data['radius_out'] = float(entity.RadiusOut)
                        except:
                            entity_data['radius_out'] = 0.0
                        try:
                            entity_data['spiral_type'] = str(entity.SpiralDefinition)
                        except:
                            entity_data['spiral_type'] = 'Unknown'
                        
                    elif 'Tangent' in entity_type or 'Line' in entity_type:
                        try:
                            entity_data['bearing'] = float(entity.Direction)
                        except:
                            entity_data['bearing'] = 0.0
                    
                    curves_data.append(entity_data)
                    entity_index += 1
                    
                except Exception as e:
                    # Skip problematic entities but continue
                    entity_index += 1
                    pass
                
        except Exception as e:
            # Return what we have even if there's an error
            pass
        
        return curves_data
    
    def extract_superelevation_data(self, alignment):
        """Extract superelevation data if available"""
        superelevation_data = []
        
        try:
            if hasattr(alignment, 'SuperelevationData') and alignment.SuperelevationData is not None:
                se_data = alignment.SuperelevationData
                
                # Extract critical stations if they exist
                if hasattr(se_data, 'CriticalStations'):
                    for critical_station in se_data.CriticalStations:
                        try:
                            superelevation_data.append({
                                'station': getattr(critical_station, 'Station', 0.0),
                                'type': critical_station.TransitionType.ToString() if hasattr(critical_station, 'TransitionType') else 'Unknown',
                                'left_slope': getattr(critical_station, 'LeftOutsideSlope', 0.0),
                                'right_slope': getattr(critical_station, 'RightOutsideSlope', 0.0)
                            })
                        except:
                            # Skip problematic critical stations
                            pass
        except:
            # Superelevation might not be available - this is fine
            pass
        
        return superelevation_data
    
    def extract_geotable_data(self, alignment_name=None, station_interval=10.0):
        """
        Main method to extract complete geotable data for an alignment
        
        Parameters:
        - alignment_name: Name of specific alignment (None for all alignments)
        - station_interval: Interval for station sampling
        
        Returns:
        - Dictionary containing all geotable data
        """
        geotable_data = {
            'project_name': str(self.acad_doc.Name),
            'timestamp': str(DateTime.Now.ToString("yyyy-MM-dd HH:mm:ss")),
            'alignments': []
        }
        
        alignments = self.get_all_alignments()
        
        # Filter by name if specified
        if alignment_name:
            alignments = [a for a in alignments if a['name'] == alignment_name]
        
        for alignment_info in alignments:
            alignment_obj = alignment_info['object']
            
            # Convert all .NET types to Python types explicitly
            # DON'T include the 'object' itself - it's a .NET object that can't be serialized
            alignment_data = {
                'name': str(alignment_info['name']),
                'description': str(alignment_info['description']),
                'id': str(alignment_info['id']),
                'length': float(alignment_info['length']),
                'start_station': float(alignment_info['start_station']),
                'end_station': float(alignment_info['end_station']),
                'stations': self.extract_alignment_stations(alignment_obj, station_interval),
                'curves': self.extract_alignment_curves(alignment_obj),
                'superelevation': self.extract_superelevation_data(alignment_obj)
            }
            
            # Note: we don't include alignment_info['object'] because it's a .NET object
            
            geotable_data['alignments'].append(alignment_data)
        
        return geotable_data


# ============= DYNAMO SCRIPT ENTRY POINT =============
# The code below this line is executed when run in Dynamo

def sanitize_for_python(obj):
    """Recursively convert all .NET types to Python native types"""
    if obj is None:
        return None
    
    # Check if already a Python dict (most important check first!)
    if isinstance(obj, dict):
        py_dict = {}
        for k, v in obj.items():
            py_dict[str(k)] = sanitize_for_python(v)
        return py_dict
    
    # Check if already a Python list
    if isinstance(obj, list):
        return [sanitize_for_python(item) for item in obj]
    
    # Check if already a Python tuple
    if isinstance(obj, tuple):
        return tuple(sanitize_for_python(item) for item in obj)
    
    # Handle booleans (before numbers!)
    if isinstance(obj, bool):
        return bool(obj)
    
    # Handle strings
    if isinstance(obj, str):
        return str(obj)
    
    # Handle numbers (int and float)
    if isinstance(obj, (int, float)) and not isinstance(obj, bool):
        try:
            return float(str(obj))
        except:
            return obj
    
    # Now handle .NET dict-like objects (have both 'keys' and 'items' methods)
    # Check BOTH to ensure it's really dict-like and not just iterable
    if hasattr(obj, 'keys') and hasattr(obj, 'items'):
        try:
            if callable(getattr(obj, 'items')) and callable(getattr(obj, 'keys')):
                py_dict = {}
                for k, v in obj.items():
                    py_dict[str(k)] = sanitize_for_python(v)
                return py_dict
        except:
            pass
    
    # Handle .NET list-like objects (iterable but not string/dict)
    # But first make sure it's NOT dict-like!
    if not hasattr(obj, 'keys'):
        try:
            # Try to iterate
            py_list = []
            for item in obj:
                py_list.append(sanitize_for_python(item))
            return py_list
        except (TypeError, AttributeError):
            pass
    
    # Last resort: convert to string
    return str(obj)


def main(alignment_name=None, station_interval=10.0):
    """
    Main function called by Dynamo
    
    Inputs (IN[0], IN[1]):
    - alignment_name: String - Name of alignment to extract (None for all)
    - station_interval: Float - Station sampling interval in drawing units
    
    Output (OUT):
    - Dictionary containing all extracted geotable data
    """
    try:
        extractor = GeoTableDataExtractor()
        result = extractor.extract_geotable_data(alignment_name, station_interval)
        
        # Recursively sanitize all data to pure Python types
        sanitized_result = sanitize_for_python(result)
        
        return sanitized_result
        
    except Exception as e:
        return "Error: " + str(e)


# Check if running in Dynamo context
if 'IN' in dir():
    # Get inputs from Dynamo
    alignment_name = IN[0] if len(IN) > 0 and IN[0] != "" else None
    station_interval = IN[1] if len(IN) > 1 else 10.0
    
    # Execute and return output
    OUT = main(alignment_name, station_interval)
else:
    # Standalone execution for testing
    OUT = "Script loaded successfully. Use in Dynamo context."
# ----------------------------------------
code_block = CodeBlock { "C:/Users/amartinez/Downloads/Organized/Code/alignment_report.pdf"; }
code_block_2 = CodeBlock { "auto"; }
pdf_report = Python(IN[0]=data_extractor_from_civil_3d, IN[1]=code_block, IN[2]=code_block_2)  # CPython3
# ---------- pdf_report.python (602 lines) ----------
"""
Civil 3D GeoTable Report Generator - Portable Version
Generates PDF reports if ReportLab is available, otherwise falls back to formatted text

NO INSTALLATION REQUIRED - Works with or without ReportLab

Usage in Dynamo:
- IN[0]: geotable data (list) or XML file path (string)
- IN[1]: output file path (.pdf or .txt)
- IN[2]: report_type: 'auto', 'vertical', or 'horizontal'
- OUT: File path or error message
"""

from datetime import datetime
import xml.etree.ElementTree as ET
import os

# Try to import ReportLab - if not available, will use text fallback
try:
    from reportlab.lib import colors
    from reportlab.lib.pagesizes import letter, landscape
    from reportlab.lib.styles import getSampleStyleSheet, ParagraphStyle
    from reportlab.lib.units import inch
    from reportlab.platypus import SimpleDocTemplate, Table, TableStyle, Paragraph, Spacer
    from reportlab.lib.enums import TA_LEFT, TA_CENTER, TA_RIGHT
    REPORTLAB_AVAILABLE = True
except ImportError:
    REPORTLAB_AVAILABLE = False


class GeoTableReportGenerator:
    """Generate reports in PDF (if ReportLab available) or text format"""

    def __init__(self, alignment_data):
        """Initialize with parsed alignment data (dict format)"""
        self.alignment = alignment_data

    def generate_report(self, output_path, report_type='auto'):
        """
        Generate report - automatically chooses PDF or text based on ReportLab availability

        Parameters:
        - output_path: Output file path (.pdf or .txt)
        - report_type: 'vertical', 'horizontal', or 'auto'
        """
        # Determine report type
        if report_type == 'auto':
            report_type = self._detect_report_type()

        # Force PDF extension if ReportLab is available
        if REPORTLAB_AVAILABLE and not output_path.lower().endswith('.pdf'):
            output_path = output_path.rsplit('.', 1)[0] + '.pdf'

        # Force TXT extension if ReportLab not available
        if not REPORTLAB_AVAILABLE and not output_path.lower().endswith('.txt'):
            output_path = output_path.rsplit('.', 1)[0] + '.txt'

        if REPORTLAB_AVAILABLE:
            return self._generate_pdf(output_path, report_type)
        else:
            return self._generate_text(output_path, report_type)

    def _generate_pdf(self, output_path, report_type):
        """Generate PDF using ReportLab"""
        if report_type == 'horizontal':
            pagesize = landscape(letter)
        else:
            pagesize = letter

        doc = SimpleDocTemplate(
            output_path,
            pagesize=pagesize,
            rightMargin=0.5*inch,
            leftMargin=0.5*inch,
            topMargin=0.5*inch,
            bottomMargin=0.5*inch
        )

        story = []
        if report_type == 'vertical':
            story = self._build_vertical_pdf()
        else:
            story = self._build_horizontal_pdf()

        doc.build(story)
        return output_path

    def _generate_text(self, output_path, report_type):
        """Generate formatted text file (fallback when ReportLab not available)"""
        lines = []

        # Header
        lines.append(f"Project Name: {self.alignment.get('project_name', 'Unknown')}")
        lines.append(f"   Description: {self.alignment.get('description', '')}")

        if self.alignment.get('horizontal_alignment'):
            lines.append(f"Horizontal Alignment Name: {self.alignment.get('horizontal_alignment')}")
            lines.append(f"   Description:")
            lines.append(f"        Style: {self.alignment.get('style', 'Default')}")

        if self.alignment.get('vertical_alignment'):
            lines.append(f"Vertical Alignment Name: {self.alignment.get('vertical_alignment')}")
            lines.append(f"   Description:")
            lines.append(f"        Style: {self.alignment.get('style', 'Default')}")

        lines.append("")

        # Column headers
        if report_type == 'vertical':
            lines.append(f"{'':40s} {'STATION':>15s} {'ELEVATION':>15s}")
        else:
            lines.append(f"{'':40s} {'STATION':>15s} {'NORTHING':>15s} {'EASTING':>15s}")

        lines.append("")

        # Elements
        for element in self.alignment.get('elements', []):
            element_type = element.get('type', 'Unknown')
            lines.append(f"Element: {element_type}")

            # Station points
            for station in element.get('stations', []):
                point_type = station.get('point_type', '')
                station_str = self._format_station(station.get('station', 0))

                if report_type == 'vertical':
                    elevation = station.get('elevation', 0)
                    lines.append(f"    {point_type:20s} {station_str:>15s} {elevation:>15.2f}")
                else:
                    northing = station.get('y', 0)
                    easting = station.get('x', 0)
                    lines.append(f"    {point_type:15s} ( ) {station_str:>15s} {northing:>15.4f} {easting:>15.4f}")

            # Properties
            props = element.get('properties', {})
            for prop_name, prop_value in props.items():
                if report_type == 'horizontal' and (':' in prop_name or 'Direction' in prop_name):
                    lines.append(f"    {prop_name:25s} {prop_value}")
                else:
                    lines.append(f"    {prop_name:20s} {prop_value:>15s}")

            lines.append("")

        # Write to file
        with open(output_path, 'w') as f:
            f.write('\n'.join(lines))

        return output_path

    def _build_vertical_pdf(self):
        """Build vertical alignment PDF content"""
        story = []
        styles = getSampleStyleSheet()

        title_style = ParagraphStyle(
            'CustomTitle',
            parent=styles['Normal'],
            fontSize=10,
            leading=12,
            leftIndent=0
        )

        # Header
        story.append(Paragraph(f"<b>Project Name:</b> {self.alignment.get('project_name', 'Unknown')}", title_style))
        story.append(Paragraph(f"<b>   Description:</b> {self.alignment.get('description', '')}", title_style))

        if self.alignment.get('horizontal_alignment'):
            story.append(Paragraph(f"<b>Horizontal Alignment Name:</b> {self.alignment.get('horizontal_alignment')}", title_style))
            story.append(Paragraph(f"<b>   Description:</b>", title_style))
            story.append(Paragraph(f"<b>        Style:</b> {self.alignment.get('style', 'Default')}", title_style))

        if self.alignment.get('vertical_alignment'):
            story.append(Paragraph(f"<b>Vertical Alignment Name:</b> {self.alignment.get('vertical_alignment')}", title_style))
            story.append(Paragraph(f"<b>   Description:</b>", title_style))
            story.append(Paragraph(f"<b>        Style:</b> {self.alignment.get('style', 'Default')}", title_style))

        story.append(Spacer(1, 0.2*inch))

        # Column headers
        header_data = [['', 'STATION', 'ELEVATION']]
        header_table = Table(header_data, colWidths=[3.5*inch, 1.5*inch, 1.5*inch])
        header_table.setStyle(TableStyle([
            ('FONT', (0, 0), (-1, -1), 'Courier-Bold', 9),
            ('ALIGN', (1, 0), (-1, -1), 'RIGHT'),
        ]))
        story.append(header_table)
        story.append(Spacer(1, 0.1*inch))

        # Elements
        for element in self.alignment.get('elements', []):
            element_type = element.get('type', 'Unknown')
            story.append(Paragraph(f"<b>Element: {element_type}</b>", title_style))

            element_data = []
            for station in element.get('stations', []):
                point_type = station.get('point_type', '')
                station_str = self._format_station(station.get('station', 0))
                elevation = station.get('elevation', 0)
                element_data.append([f"    {point_type}", station_str, f"{elevation:.2f}"])

            if element_data:
                station_table = Table(element_data, colWidths=[3.5*inch, 1.5*inch, 1.5*inch])
                station_table.setStyle(TableStyle([
                    ('FONT', (0, 0), (-1, -1), 'Courier', 8),
                    ('ALIGN', (1, 0), (-1, -1), 'RIGHT'),
                ]))
                story.append(station_table)

            props = element.get('properties', {})
            prop_data = []
            for prop_name, prop_value in props.items():
                prop_data.append([f"    {prop_name}", prop_value, ''])

            if prop_data:
                prop_table = Table(prop_data, colWidths=[3.5*inch, 1.5*inch, 1.5*inch])
                prop_table.setStyle(TableStyle([
                    ('FONT', (0, 0), (-1, -1), 'Courier', 8),
                    ('ALIGN', (1, 0), (-1, -1), 'RIGHT'),
                ]))
                story.append(prop_table)

            story.append(Spacer(1, 0.15*inch))

        return story

    def _build_horizontal_pdf(self):
        """Build horizontal alignment PDF content"""
        story = []
        styles = getSampleStyleSheet()

        title_style = ParagraphStyle(
            'CustomTitle',
            parent=styles['Normal'],
            fontSize=10,
            leading=12,
            leftIndent=0
        )

        # Header
        story.append(Paragraph(f"<b>Project Name:</b> {self.alignment.get('project_name', 'Unknown')}", title_style))
        story.append(Paragraph(f"<b>   Description:</b> {self.alignment.get('description', '')}", title_style))
        story.append(Paragraph(f"<b>Horizontal Alignment Name:</b> {self.alignment.get('horizontal_alignment', self.alignment.get('name'))}", title_style))
        story.append(Paragraph(f"<b>   Description:</b>", title_style))
        story.append(Paragraph(f"<b>        Style:</b> {self.alignment.get('style', 'Default')}", title_style))
        story.append(Spacer(1, 0.2*inch))

        # Column headers
        header_data = [['', 'STATION', 'NORTHING', 'EASTING']]
        header_table = Table(header_data, colWidths=[3*inch, 1.5*inch, 1.75*inch, 1.75*inch])
        header_table.setStyle(TableStyle([
            ('FONT', (0, 0), (-1, -1), 'Courier-Bold', 9),
            ('ALIGN', (1, 0), (-1, -1), 'RIGHT'),
        ]))
        story.append(header_table)
        story.append(Spacer(1, 0.1*inch))

        # Elements
        for element in self.alignment.get('elements', []):
            element_type = element.get('type', 'Unknown')
            story.append(Paragraph(f"<b>Element: {element_type}</b>", title_style))

            element_data = []
            for station in element.get('stations', []):
                point_type = station.get('point_type', '')
                station_str = self._format_station(station.get('station', 0))
                northing = station.get('y', 0)
                easting = station.get('x', 0)
                element_data.append([f"    {point_type} ( )", station_str, f"{northing:.4f}", f"{easting:.4f}"])

            if element_data:
                station_table = Table(element_data, colWidths=[3*inch, 1.5*inch, 1.75*inch, 1.75*inch])
                station_table.setStyle(TableStyle([
                    ('FONT', (0, 0), (-1, -1), 'Courier', 8),
                    ('ALIGN', (1, 0), (-1, -1), 'RIGHT'),
                ]))
                story.append(station_table)

            props = element.get('properties', {})
            prop_data = []
            for prop_name, prop_value in props.items():
                prop_data.append([f"    {prop_name}", prop_value, '', ''])

            if prop_data:
                prop_table = Table(prop_data, colWidths=[3*inch, 1.5*inch, 1.75*inch, 1.75*inch])
                prop_table.setStyle(TableStyle([
                    ('FONT', (0, 0), (-1, -1), 'Courier', 8),
                    ('ALIGN', (1, 0), (1, -1), 'LEFT'),
                ]))
                story.append(prop_table)

            story.append(Spacer(1, 0.15*inch))

        return story

    def _detect_report_type(self):
        """Auto-detect vertical vs horizontal report"""
        has_elevations = any(
            station.get('elevation') is not None
            for element in self.alignment.get('elements', [])
            for station in element.get('stations', [])
        )

        has_coordinates = any(
            station.get('x', 0) != 0 or station.get('y', 0) != 0
            for element in self.alignment.get('elements', [])
            for station in element.get('stations', [])
        )

        return 'horizontal' if has_coordinates else 'vertical'

    def _format_station(self, station_value):
        """Format station value to Civil 3D format"""
        if station_value >= 100:
            hundreds = int(station_value / 100)
            remainder = station_value % 100
            return f"{hundreds}+{remainder:05.2f}"
        else:
            return f"{station_value:.2f}"


# ============= HELPER FUNCTIONS (from original scripts) =============

def parse_station_value(station_str):
    """Convert Civil 3D station format to float"""
    try:
        station_str = str(station_str).strip()
        if '+' in station_str:
            parts = station_str.split('+')
            if len(parts) == 2:
                return float(parts[0]) * 100 + float(parts[1])
        return float(station_str)
    except:
        return 0.0


def parse_geotable_to_alignment(geotable_rows):
    """Parse raw geotable rows into alignment dictionary"""
    alignment = {
        'name': 'Unknown',
        'project_name': '',
        'description': '',
        'horizontal_alignment': '',
        'vertical_alignment': '',
        'style': '',
        'elements': []
    }

    current_element = None

    for row in geotable_rows:
        if not isinstance(row, list) or len(row) < 2:
            continue

        prop_name = str(row[0]).strip()
        prop_value = str(row[1]).strip() if len(row) > 1 else ''
        third_value = str(row[2]).strip() if len(row) > 2 else ''

        prop_name_lower = prop_name.lower()

        if prop_name_lower == '' and prop_value.upper() in ['STATION', 'NORTHING']:
            continue

        if 'project name' in prop_name_lower:
            alignment['project_name'] = prop_value
        elif 'horizontal alignment name' in prop_name_lower:
            alignment['horizontal_alignment'] = prop_value
            if not alignment['name'] or alignment['name'] == 'Unknown':
                alignment['name'] = prop_value
        elif 'vertical alignment name' in prop_name_lower:
            alignment['vertical_alignment'] = prop_value
        elif prop_name_lower == 'style':
            alignment['style'] = prop_value
        elif prop_name_lower == 'description':
            alignment['description'] = prop_value
        elif prop_name_lower.startswith('element:'):
            if current_element is not None:
                alignment['elements'].append(current_element)

            element_type = prop_name.split(':')[1].strip()
            current_element = {
                'type': element_type,
                'stations': [],
                'properties': {}
            }
        elif current_element is not None and prop_value:
            station_val = parse_station_value(prop_value)

            if station_val > 0 and third_value:
                try:
                    numeric_third = float(third_value)
                    current_element['stations'].append({
                        'point_type': prop_name,
                        'station': station_val,
                        'elevation': numeric_third,
                        'x': 0.0,
                        'y': 0.0
                    })
                except ValueError:
                    current_element['properties'][prop_name] = prop_value
            else:
                current_element['properties'][prop_name] = prop_value

    if current_element is not None:
        alignment['elements'].append(current_element)

    return alignment


def parse_xml_to_alignment(xml_path):
    """Parse XML file to alignment dictionary"""
    tree = ET.parse(xml_path)
    root = tree.getroot()

    ns = {'geo': 'http://civil3d.autodesk.com/geotable'}

    project_info = root.find('.//geo:ProjectInfo', ns) or root.find('.//ProjectInfo')
    project_name = ''
    if project_info is not None:
        proj_name_elem = project_info.find('.//geo:ProjectName', ns) or project_info.find('.//ProjectName')
        if proj_name_elem is not None:
            project_name = proj_name_elem.text or ''

    alignment_elem = root.find('.//geo:Alignment', ns) or root.find('.//Alignment')
    if alignment_elem is None:
        raise ValueError("No alignment found in XML")

    alignment = {
        'name': alignment_elem.get('name', 'Unknown'),
        'project_name': project_name,
        'description': '',
        'horizontal_alignment': alignment_elem.get('name', ''),
        'vertical_alignment': '',
        'style': 'Default',
        'elements': []
    }

    elements = alignment_elem.findall('.//geo:GeometricElement', ns) or alignment_elem.findall('.//GeometricElement')
    for elem in elements:
        element_type = elem.get('type', 'Unknown')
        element = {
            'type': element_type,
            'stations': [],
            'properties': {}
        }

        stations = elem.findall('.//geo:Station', ns) or elem.findall('.//Station')
        for sta in stations:
            station_val = float(sta.get('value', 0))
            point_type = sta.get('pointType', '')
            x = float(sta.get('x', 0))
            y = float(sta.get('y', 0))
            z = float(sta.get('z', 0))

            element['stations'].append({
                'point_type': point_type,
                'station': station_val,
                'elevation': z,
                'x': x,
                'y': y
            })

        props = elem.findall('.//geo:Property', ns) or elem.findall('.//Property')
        for prop in props:
            prop_name = prop.get('name', '')
            prop_value = prop.get('value', '')
            element['properties'][prop_name] = prop_value

        alignment['elements'].append(element)

    return alignment


def sanitize_data(obj):
    """Recursively convert .NET types to Python native types"""
    if obj is None:
        return None

    if isinstance(obj, dict):
        py_dict = {}
        for k, v in obj.items():
            py_dict[str(k)] = sanitize_data(v)
        return py_dict

    if isinstance(obj, list):
        return [sanitize_data(item) for item in obj]

    if isinstance(obj, tuple):
        return tuple(sanitize_data(item) for item in obj)

    if isinstance(obj, bool):
        return bool(obj)

    if isinstance(obj, str):
        return str(obj)

    if isinstance(obj, (int, float)) and not isinstance(obj, bool):
        try:
            return float(str(obj))
        except:
            return obj

    if hasattr(obj, 'keys') and hasattr(obj, 'items'):
        try:
            if callable(getattr(obj, 'items')) and callable(getattr(obj, 'keys')):
                py_dict = {}
                for k, v in obj.items():
                    py_dict[str(k)] = sanitize_data(v)
                return py_dict
        except:
            pass

    if not hasattr(obj, 'keys'):
        try:
            py_list = []
            for item in obj:
                py_list.append(sanitize_data(item))
            return py_list
        except (TypeError, AttributeError):
            pass

    return str(obj)


# ============= DYNAMO ENTRY POINT =============

def main(input_data, output_path, report_type='auto'):
    """
    Main function for Dynamo - Portable version

    Inputs:
    - IN[0]: input_data - Geotable data (list) or XML file path (string)
    - IN[1]: output_path - Output file path (.pdf if ReportLab available, .txt otherwise)
    - IN[2]: report_type - 'vertical', 'horizontal', or 'auto' (default)

    Output:
    - File path with status message
    """
    try:
        # Show ReportLab status
        mode_msg = "PDF mode (ReportLab available)" if REPORTLAB_AVAILABLE else "TEXT mode (ReportLab not available)"

        # Sanitize input
        input_data = sanitize_data(input_data)

        # Determine input type
        if isinstance(input_data, str) and input_data.endswith('.xml'):
            if not os.path.exists(input_data):
                return f"Error: XML file not found: {input_data}"
            alignment_data = parse_xml_to_alignment(input_data)

        elif isinstance(input_data, list):
            if len(input_data) > 0 and isinstance(input_data[0], list):
                alignment_data = parse_geotable_to_alignment(input_data)
            elif len(input_data) > 0 and isinstance(input_data[0], dict):
                alignment_data = input_data[0]
            else:
                return "Error: Invalid list format"

        elif isinstance(input_data, dict):
            if 'alignments' in input_data:
                alignments_list = input_data['alignments']
                if len(alignments_list) == 0:
                    return "Error: No alignments in data"
                first_alignment = alignments_list[0]
                if isinstance(first_alignment, list):
                    alignment_data = parse_geotable_to_alignment(first_alignment)
                else:
                    alignment_data = first_alignment
            else:
                alignment_data = input_data

        else:
            return f"Error: Invalid input type: {type(input_data)}"

        if not isinstance(alignment_data, dict):
            return f"Error: alignment_data is {type(alignment_data)}, expected dict"

        # Generate report
        generator = GeoTableReportGenerator(alignment_data)
        result_path = generator.generate_report(output_path, report_type)

        # Return success message with mode info
        file_type = "PDF" if result_path.lower().endswith('.pdf') else "TEXT"
        return f"{file_type} report saved to: {result_path}\n({mode_msg})"

    except Exception as e:
        import traceback
        return f"Error generating report: {str(e)}\n{traceback.format_exc()}"


# Dynamo execution
if 'IN' in dir():
    input_data = IN[0] if len(IN) > 0 else []
    output_path = IN[1] if len(IN) > 1 and IN[1] != "" else None
    report_type = IN[2] if len(IN) > 2 else 'auto'

    if output_path is None:
        OUT = "Error: Output file path required (IN[1])"
    else:
        OUT = main(input_data, output_path, report_type)
else:
    OUT = "Portable script loaded. Works with or without ReportLab installed."
# ----------------------------------------
code_block_3 = CodeBlock()
# ---------- code_block_3.designscript (6 lines) ----------
// XML Output Configuration
// Leave empty for XML string output, or specify path
output_path = "C:/Users/anmartinez/Downloads/Organized/Code/xml_report.xml";

// Pretty print formatting
pretty_print = true;
# ----------------------------------------
python_script = Python(IN[0]=pdf_report, IN[1]=code_block_3.output_path, IN[2]=code_block_3.pretty_print)  # CPython3
# ---------- python_script.python (589 lines) ----------
"""
XML Report Generator for Civil 3D Geotable Data
Converts extracted geotable data into formatted XML reports

Usage in Dynamo:
- Import as second Python Script node
- Connect output from civil3d_geotable_extractor.py
- Outputs formatted XML string or file
"""

import xml.etree.ElementTree as ET
from xml.dom import minidom
import json
import sys
from datetime import datetime


class XMLReportGenerator:
    """Generate XML reports from geotable data"""
    
    def __init__(self, geotable_data):
        """Initialize with geotable data dictionary"""
        self.data = geotable_data
        self.root = None
        
    def create_xml_structure(self):
        """Create the main XML structure"""
        # Create root element
        self.root = ET.Element('GeotableReport')
        self.root.set('version', '1.0')
        self.root.set('xmlns', 'http://civil3d.autodesk.com/geotable')
        
        # Add project information
        project_info = ET.SubElement(self.root, 'ProjectInfo')
        ET.SubElement(project_info, 'ProjectName').text = self.data.get('project_name', 'Unknown')
        ET.SubElement(project_info, 'GeneratedDate').text = self.data.get('timestamp', 
                                                                          datetime.now().strftime('%Y-%m-%d %H:%M:%S'))
        ET.SubElement(project_info, 'ReportType').text = 'Rail Alignment Geotable'
        
        # Add alignments section
        alignments_section = ET.SubElement(self.root, 'Alignments')
        alignments_section.set('count', str(len(self.data.get('alignments', []))))
        
        return alignments_section
    
    def add_alignment_to_xml(self, alignment_data, parent_element):
        """Add a single alignment's data to XML"""
        alignment_elem = ET.SubElement(parent_element, 'Alignment')
        alignment_elem.set('name', alignment_data.get('name', 'Unnamed'))
        alignment_elem.set('id', alignment_data.get('id', ''))

        # Basic properties
        properties = ET.SubElement(alignment_elem, 'Properties')
        ET.SubElement(properties, 'Description').text = alignment_data.get('description', '')

        # Add project name if available
        if alignment_data.get('project_name'):
            ET.SubElement(properties, 'ProjectName').text = alignment_data.get('project_name', '')

        # Add horizontal/vertical alignment names if available
        if alignment_data.get('horizontal_alignment'):
            ET.SubElement(properties, 'HorizontalAlignment').text = alignment_data.get('horizontal_alignment', '')
        if alignment_data.get('vertical_alignment'):
            ET.SubElement(properties, 'VerticalAlignment').text = alignment_data.get('vertical_alignment', '')
        if alignment_data.get('style'):
            ET.SubElement(properties, 'Style').text = alignment_data.get('style', '')

        ET.SubElement(properties, 'Length').text = str(round(alignment_data.get('length', 0), 3))
        ET.SubElement(properties, 'StartStation').text = str(round(alignment_data.get('start_station', 0), 3))
        ET.SubElement(properties, 'EndStation').text = str(round(alignment_data.get('end_station', 0), 3))

        # Station data
        self.add_stations_to_xml(alignment_data.get('stations', []), alignment_elem)

        # Elements data (detailed geometric elements from geotable)
        if alignment_data.get('elements'):
            self.add_elements_to_xml(alignment_data.get('elements', []), alignment_elem)

        # Curve data (from extractor)
        if alignment_data.get('curves'):
            self.add_curves_to_xml(alignment_data.get('curves', []), alignment_elem)

        # Superelevation data
        if alignment_data.get('superelevation'):
            self.add_superelevation_to_xml(alignment_data.get('superelevation', []), alignment_elem)
    
    def add_stations_to_xml(self, stations_data, parent_element):
        """Add station data to XML"""
        stations_elem = ET.SubElement(parent_element, 'Stations')
        stations_elem.set('count', str(len(stations_data)))

        for station in stations_data:
            station_elem = ET.SubElement(stations_elem, 'Station')
            station_elem.set('value', str(round(station.get('station', 0), 3)))

            # Add point type if available (POB, PVI, PVC, PVT, etc.)
            if station.get('point_type'):
                station_elem.set('type', station.get('point_type'))

            # Coordinates
            coords = ET.SubElement(station_elem, 'Coordinates')
            ET.SubElement(coords, 'X').text = str(round(station.get('x', 0), 6))
            ET.SubElement(coords, 'Y').text = str(round(station.get('y', 0), 6))
            ET.SubElement(coords, 'Z').text = str(round(station.get('z', 0), 6))

            # Elevation (if different from Z or explicitly provided)
            if station.get('elevation') is not None:
                ET.SubElement(station_elem, 'Elevation').text = str(round(station.get('elevation', 0), 2))

            # Direction/Bearing
            ET.SubElement(station_elem, 'Direction').text = str(round(station.get('direction', 0), 6))
            ET.SubElement(station_elem, 'Offset').text = str(round(station.get('offset', 0), 3))
    
    def add_elements_to_xml(self, elements_data, parent_element):
        """Add detailed geometric elements from geotable to XML"""
        elements_elem = ET.SubElement(parent_element, 'GeometricElements')
        elements_elem.set('count', str(len(elements_data)))

        for idx, element in enumerate(elements_data):
            element_elem = ET.SubElement(elements_elem, 'Element')
            element_elem.set('type', element.get('type', 'Unknown'))
            element_elem.set('index', str(idx))

            # Add element stations (POB, PVI, PVC, PVT, etc.)
            if element.get('stations'):
                stations_elem = ET.SubElement(element_elem, 'Stations')
                for station in element.get('stations', []):
                    station_elem = ET.SubElement(stations_elem, 'Station')
                    station_elem.set('type', station.get('point_type', 'Unknown'))
                    station_elem.set('value', str(round(station.get('station', 0), 2)))

                    if station.get('elevation') is not None:
                        ET.SubElement(station_elem, 'Elevation').text = str(round(station.get('elevation', 0), 2))

            # Add element properties
            if element.get('properties'):
                props_elem = ET.SubElement(element_elem, 'ElementProperties')
                for prop_name, prop_value in element.get('properties', {}).items():
                    prop_elem = ET.SubElement(props_elem, 'Property')
                    prop_elem.set('name', prop_name)
                    prop_elem.text = str(prop_value)

    def add_curves_to_xml(self, curves_data, parent_element):
        """Add curve/entity data to XML"""
        curves_elem = ET.SubElement(parent_element, 'GeometricEntities')
        curves_elem.set('count', str(len(curves_data)))

        for curve in curves_data:
            entity_elem = ET.SubElement(curves_elem, 'Entity')
            entity_elem.set('type', curve.get('type', 'Unknown'))
            entity_elem.set('index', str(curve.get('index', 0)))

            # Common properties
            ET.SubElement(entity_elem, 'StartStation').text = str(round(curve.get('start_station', 0), 3))
            ET.SubElement(entity_elem, 'EndStation').text = str(round(curve.get('end_station', 0), 3))
            ET.SubElement(entity_elem, 'Length').text = str(round(curve.get('length', 0), 3))

            # Type-specific properties
            if curve.get('type') == 'Arc':
                arc_props = ET.SubElement(entity_elem, 'ArcProperties')
                ET.SubElement(arc_props, 'Radius').text = str(round(curve.get('radius', 0), 3))
                ET.SubElement(arc_props, 'ChordLength').text = str(round(curve.get('chord_length', 0), 3))
                ET.SubElement(arc_props, 'Direction').text = curve.get('direction', 'CW')

            elif curve.get('type') == 'Spiral':
                spiral_props = ET.SubElement(entity_elem, 'SpiralProperties')
                ET.SubElement(spiral_props, 'RadiusIn').text = str(round(curve.get('radius_in', 0), 3))
                ET.SubElement(spiral_props, 'RadiusOut').text = str(round(curve.get('radius_out', 0), 3))
                ET.SubElement(spiral_props, 'SpiralType').text = curve.get('spiral_type', 'Unknown')

            elif curve.get('type') == 'Line':
                line_props = ET.SubElement(entity_elem, 'LineProperties')
                ET.SubElement(line_props, 'Bearing').text = str(round(curve.get('bearing', 0), 6))
    
    def add_superelevation_to_xml(self, superelevation_data, parent_element):
        """Add superelevation data to XML"""
        se_elem = ET.SubElement(parent_element, 'Superelevation')
        se_elem.set('count', str(len(superelevation_data)))
        
        for se in superelevation_data:
            critical_elem = ET.SubElement(se_elem, 'CriticalStation')
            critical_elem.set('station', str(round(se.get('station', 0), 3)))
            
            ET.SubElement(critical_elem, 'TransitionType').text = se.get('type', 'Unknown')
            ET.SubElement(critical_elem, 'LeftSlope').text = str(round(se.get('left_slope', 0), 4))
            ET.SubElement(critical_elem, 'RightSlope').text = str(round(se.get('right_slope', 0), 4))
    
    def generate_xml(self):
        """Generate complete XML structure"""
        alignments_section = self.create_xml_structure()
        
        # Add each alignment
        for alignment in self.data.get('alignments', []):
            self.add_alignment_to_xml(alignment, alignments_section)
        
        return self.root
    
    def to_xml_string(self, pretty_print=True):
        """Convert to XML string"""
        xml_root = self.generate_xml()
        
        if pretty_print:
            # Pretty print with proper indentation
            rough_string = ET.tostring(xml_root, encoding='utf-8')
            reparsed = minidom.parseString(rough_string)
            return reparsed.toprettyxml(indent="  ", encoding='utf-8').decode('utf-8')
        else:
            return ET.tostring(xml_root, encoding='utf-8').decode('utf-8')
    
    def save_to_file(self, file_path, pretty_print=True):
        """Save XML to file"""
        xml_string = self.to_xml_string(pretty_print)
        
        with open(file_path, 'w', encoding='utf-8') as f:
            f.write(xml_string)
        
        return file_path


# ============= DYNAMO SCRIPT ENTRY POINT =============

def sanitize_data(obj):
    """Force convert any object to Python native types"""
    if obj is None:
        return None
    
    # Check if already a Python dict (most important check first!)
    if isinstance(obj, dict):
        py_dict = {}
        for k, v in obj.items():
            py_dict[str(k)] = sanitize_data(v)
        return py_dict
    
    # Check if already a Python list
    if isinstance(obj, list):
        return [sanitize_data(item) for item in obj]
    
    # Check if already a Python tuple
    if isinstance(obj, tuple):
        return tuple(sanitize_data(item) for item in obj)
    
    # Handle booleans (before numbers!)
    if isinstance(obj, bool):
        return bool(obj)
    
    # Handle strings
    if isinstance(obj, str):
        return str(obj)
    
    # Handle numbers (int and float)
    if isinstance(obj, (int, float)) and not isinstance(obj, bool):
        try:
            return float(str(obj))
        except:
            return obj
    
    # Now handle .NET dict-like objects (have both 'keys' and 'items' methods)
    # Check BOTH to ensure it's really dict-like and not just iterable
    if hasattr(obj, 'keys') and hasattr(obj, 'items'):
        try:
            if callable(getattr(obj, 'items')) and callable(getattr(obj, 'keys')):
                py_dict = {}
                for k, v in obj.items():
                    py_dict[str(k)] = sanitize_data(v)
                return py_dict
        except:
            pass
    
    # Handle .NET list-like objects (iterable but not string/dict)
    # But first make sure it's NOT dict-like!
    if not hasattr(obj, 'keys'):
        try:
            # Try to iterate
            py_list = []
            for item in obj:
                py_list.append(sanitize_data(item))
            return py_list
        except (TypeError, AttributeError):
            pass
    
    # Last resort: convert to string
    return str(obj)


def convert_geotable_list_to_dict(geotable_list):
    """
    Convert raw geotable list format to dictionary format

    Input: List of lists like [['Name, Text'], ['Description, Text'], ...]
    Output: Dictionary structure compatible with XMLReportGenerator
    """
    result = {
        'project_name': 'Civil 3D Geotable Export',
        'timestamp': datetime.now().strftime('%Y-%m-%d %H:%M:%S'),
        'alignments': []
    }

    # Check if this is a list of geotables (multiple alignments)
    if isinstance(geotable_list, list) and len(geotable_list) > 0:

        # Case 1: Single geotable (list of rows)
        if isinstance(geotable_list[0], list) and len(geotable_list[0]) == 2:
            # This is a single geotable with rows like ['Property', 'Value']
            alignment_dict = parse_geotable_rows(geotable_list)
            if alignment_dict:
                result['alignments'].append(alignment_dict)

        # Case 2: Multiple geotables (list of geotables)
        else:
            for item in geotable_list:
                if isinstance(item, list):
                    alignment_dict = parse_geotable_rows(item)
                    if alignment_dict:
                        result['alignments'].append(alignment_dict)

    return result


def parse_station_value(station_str):
    """
    Convert Civil 3D station format to float
    Examples: "641+44.67" -> 64144.67, "100.50" -> 100.50
    """
    try:
        station_str = str(station_str).strip()
        if '+' in station_str:
            # Format: "641+44.67"
            parts = station_str.split('+')
            if len(parts) == 2:
                return float(parts[0]) * 100 + float(parts[1])
        # Direct numeric value
        return float(station_str)
    except:
        return 0.0


def parse_geotable_rows(rows):
    """
    Parse geotable rows into alignment dictionary

    Input: List of [property, value] pairs from Civil 3D geotable
    Output: Alignment dictionary with detailed geometric data
    """
    alignment = {
        'name': 'Unknown',
        'id': '',
        'description': '',
        'length': 0.0,
        'start_station': 0.0,
        'end_station': 0.0,
        'project_name': '',
        'horizontal_alignment': '',
        'vertical_alignment': '',
        'style': '',
        'stations': [],
        'curves': [],
        'elements': [],
        'superelevation': []
    }

    current_element = None
    current_element_type = None
    station_data = []

    for i, row in enumerate(rows):
        if not isinstance(row, list) or len(row) < 2:
            continue

        # Get property name and value
        prop_name = str(row[0]).strip()
        prop_value = str(row[1]).strip() if len(row) > 1 else ''

        # Check if there's a third column (e.g., ELEVATION)
        third_value = str(row[2]).strip() if len(row) > 2 else ''

        prop_name_lower = prop_name.lower()

        # Skip header rows
        if prop_name_lower == '' and prop_value.upper() == 'STATION':
            continue

        # Project-level properties
        if 'project name' in prop_name_lower:
            alignment['project_name'] = prop_value
        elif 'horizontal alignment name' in prop_name_lower:
            alignment['horizontal_alignment'] = prop_value
            if not alignment['name'] or alignment['name'] == 'Unknown':
                alignment['name'] = prop_value
        elif 'vertical alignment name' in prop_name_lower:
            alignment['vertical_alignment'] = prop_value
        elif prop_name_lower == 'style':
            alignment['style'] = prop_value
        elif prop_name_lower == 'description':
            alignment['description'] = prop_value

        # Element headers (Linear, Parabola, Spiral, etc.)
        elif prop_name_lower.startswith('element:'):
            # Save previous element if exists
            if current_element is not None:
                alignment['elements'].append(current_element)

            # Start new element
            element_type = prop_name.split(':')[1].strip()
            current_element_type = element_type
            current_element = {
                'type': element_type,
                'properties': {},
                'stations': []
            }

        # Station points with elevation (POB, PVI, PVC, PVT, etc.)
        elif prop_value and third_value and current_element is not None:
            # Try to parse as station+elevation pair
            station_val = parse_station_value(prop_value)
            try:
                elevation_val = float(third_value)

                if station_val > 0 or elevation_val != 0:
                    current_element['stations'].append({
                        'point_type': prop_name,
                        'station': station_val,
                        'elevation': elevation_val
                    })

                    # Also track for overall alignment
                    station_data.append({
                        'station': station_val,
                        'elevation': elevation_val,
                        'point_type': prop_name,
                        'x': 0.0,
                        'y': 0.0,
                        'z': elevation_val,
                        'direction': 0.0,
                        'offset': 0.0
                    })
                else:
                    # Not a valid station/elevation, treat as property
                    if current_element is not None:
                        current_element['properties'][prop_name] = prop_value
            except ValueError:
                # Not a numeric elevation, treat as property
                if current_element is not None:
                    current_element['properties'][prop_name] = prop_value

        # Element properties
        elif current_element is not None and prop_value and prop_name:
            current_element['properties'][prop_name] = prop_value

        # Fallback: generic property mapping
        elif 'length' in prop_name_lower and current_element is None:
            try:
                alignment['length'] = float(prop_value)
            except:
                pass
        elif 'start' in prop_name_lower and 'station' in prop_name_lower:
            try:
                alignment['start_station'] = parse_station_value(prop_value)
            except:
                pass
        elif 'end' in prop_name_lower and 'station' in prop_name_lower:
            try:
                alignment['end_station'] = parse_station_value(prop_value)
            except:
                pass
        elif 'id' in prop_name_lower:
            alignment['id'] = prop_value

    # Save last element
    if current_element is not None:
        alignment['elements'].append(current_element)

    # Add collected station data
    alignment['stations'] = station_data

    # Calculate start/end stations if not set
    if station_data:
        if alignment['start_station'] == 0.0:
            alignment['start_station'] = min(s['station'] for s in station_data)
        if alignment['end_station'] == 0.0:
            alignment['end_station'] = max(s['station'] for s in station_data)

    return alignment


def main(geotable_data, output_path=None, pretty_print=True):
    """
    Main function called by Dynamo

    Inputs (IN[0], IN[1], IN[2]):
    - geotable_data: Dictionary or List - Output from civil3d_geotable_extractor.py or raw geotable
    - output_path: String - File path to save XML (optional, None for string output)
    - pretty_print: Boolean - Whether to format XML with indentation

    Output (OUT):
    - XML string or file path (if saved)
    """
    try:
        # Validate input type
        if geotable_data is None:
            return "Error: No data received from extractor"

        # DEBUG: Show what we received
        debug_info = []
        debug_info.append(f"Received type: {type(geotable_data)}")
        debug_info.append(f"Type string: {str(type(geotable_data))}")

        # Handle error input
        if isinstance(geotable_data, str):
            if geotable_data.startswith("Error"):
                return geotable_data
            else:
                return "Error: Received string instead of data dictionary: " + str(geotable_data)[:500]

        # CRITICAL: Sanitize data again here in case Dynamo converted it during transfer
        geotable_data = sanitize_data(geotable_data)

        debug_info.append(f"After sanitization type: {type(geotable_data)}")

        # Convert list format to dictionary if needed
        if isinstance(geotable_data, list):
            debug_info.append("Converting list format to dictionary structure...")
            geotable_data = convert_geotable_list_to_dict(geotable_data)
            debug_info.append(f"After conversion - Alignments count: {len(geotable_data.get('alignments', []))}")

        # Verify it's a dictionary
        if not isinstance(geotable_data, dict):
            return "Error: Expected dictionary but received: " + str(type(geotable_data)) + "\n" + "\n".join(debug_info)

        # Check if dictionary has required keys
        if 'alignments' not in geotable_data:
            return "Error: Data missing 'alignments' key. Keys found: " + str(list(geotable_data.keys())) + "\n" + "\n".join(debug_info)

        # DEBUG: Check alignments type
        alignments = geotable_data.get('alignments', [])
        debug_info.append(f"Alignments type: {type(alignments)}")
        debug_info.append(f"Alignments count: {len(alignments) if hasattr(alignments, '__len__') else 'N/A'}")

        if len(alignments) > 0:
            first_alignment = alignments[0]
            debug_info.append(f"First alignment type: {type(first_alignment)}")

            # Additional check - if alignments still contain lists, try to convert them
            if isinstance(first_alignment, list):
                debug_info.append("WARNING: Alignments still in list format after conversion. Attempting individual conversion...")
                converted_alignments = []
                for idx, alignment in enumerate(alignments):
                    if isinstance(alignment, list):
                        converted = parse_geotable_rows(alignment)
                        converted_alignments.append(converted)
                        if idx == 0:
                            debug_info.append(f"First converted alignment: {str(converted)[:200]}")
                    else:
                        converted_alignments.append(alignment)
                geotable_data['alignments'] = converted_alignments
                debug_info.append(f"Converted {len(converted_alignments)} alignments from list to dict format")
            else:
                debug_info.append(f"First alignment value (first 200 chars): {str(first_alignment)[:200]}")

        # Generate XML
        generator = XMLReportGenerator(geotable_data)

        if output_path and output_path != "":
            # Save to file
            result_path = generator.save_to_file(output_path, pretty_print)
            return "XML report saved to: " + result_path
        else:
            # Return XML string
            return generator.to_xml_string(pretty_print)

    except Exception as e:
        import traceback
        error_msg = "Error generating XML: " + str(e) + "\n" + traceback.format_exc()
        if 'debug_info' in locals():
            error_msg += "\n\nDEBUG INFO:\n" + "\n".join(debug_info)
        return error_msg


# Check if running in Dynamo context
if 'IN' in dir():
    # Get inputs from Dynamo
    geotable_data = IN[0] if len(IN) > 0 else {}
    output_path = IN[1] if len(IN) > 1 and IN[1] != "" else None
    pretty_print = IN[2] if len(IN) > 2 else True
    
    # Execute and return output
    OUT = main(geotable_data, output_path, pretty_print)
else:
    # Standalone execution for testing
    OUT = "Script loaded successfully. Use in Dynamo context."
# ----------------------------------------
watch = Watch(python_script)
